# Grasshopper definition Grasshopper Tutorial.gh (Grasshopper 1.0.5)

number_slider = Slider(33, range=0..100)
xz = XZPlane(Origin=Point(0, 0, 0))
md_slider = MDSlider(
    SliderMode=0,
    slider_value=Point(0.6110226512, 1, 0.5),
    x_domain=Domain(0, 1),
    y_domain=Domain(0, 1),
    z_domain=Domain(0, 1))
rectangle = Rectangle(Plane=xz, XSize=number_slider, YSize=number_slider, Radius=0)  # -> Rectangle, Length
boundary = BoundarySurfaces(Edges=rectangle.Rectangle)
Y = UnitY(Factor=Slider(-5, range=-25..100))
evalsrf = EvaluateSurface(Surface=reparameterize(boundary), Point=md_slider)  # -> Point, Normal, UDirection, VDirection, Frame
pop2d = Populate2D(Region=rectangle.Rectangle, Count=Slider(73, range=0..100), Seed=1)
extr = Extrude(Base=boundary, Direction=Y)
voronoi = Voronoi(Points=pop2d, BruteForceOverride=False)
cp = ClosestPoint(Point=pop2d, Cloud=evalsrf.Point)  # -> ClosestPoint, CPIndex, Distance
rint = RegionIntersection(CurvesA=voronoi, CurvesB=rectangle.Rectangle)
bnd = Bounds(Numbers=cp.Distance)
dom = ConstructDomain(DomainStart=Slider(0.6447, range=0..1), DomainEnd=Slider(0.0314, range=0..0.1))
graft = GraftTree(Tree=rint, IncludeEmptyLists=True, IncludeNullItems=True)
remap = RemapNumbers(Value=cp.Distance, Source=bnd, Target=dom)  # -> Mapped, Clipped
scale = Scale(Geometry=rint, Center=pop2d, Factor=remap.Mapped)  # -> Geometry, Transform
multiplication = Multiplication(A=remap.Mapped, B=Slider(10, range=0..10))
Y_2 = UnitY(Factor=multiplication)
move = Move(Geometry=scale.Geometry, Motion=Y_2)  # -> Geometry, Transform
graft_2 = GraftTree(Tree=move.Geometry, IncludeEmptyLists=True, IncludeNullItems=True)
boundary_2 = BoundarySurfaces(Edges=move.Geometry)
loft = Loft(
    Curves=[graft, graft_2],
    Options={Adjust=False, Closed=False, LoftEnds=0, LoftSimp=0, LoftType=0, Rebuild=10, Refit=0.01})
preview = CustomPreview(
    Geometry=[loft, boundary_2, extr],
    Material={diffuse=RGB(221, 160, 221), emission=RGB(66, 48, 66), shine=0.5, specular=RGB(255, 255, 255), transparency=0})
